# Grasshopper definition curvy_slotty.gh (Grasshopper 1.0.8)
# Copyright: Harvey Fong

angles = Panel("0.05 To (2*Pi-.05)")
frames = Panel("0 To 100")
frame = Slider(100, range=0..100)
center_box = CenterBox(Base=PlaneXY(0, 0, 0), X=1, Y=1, Z=1)
unit_z = UnitZ(Factor=1)
brep = Brep(center_box)
remap_numbers = RemapNumbers(Value=frame, Source=frames, Target=angles)  # -> Mapped, Clipped
arc = Arc(Plane=unit_z, Radius=1, Angle=remap_numbers.Mapped)  # -> Arc, Length
pipe_radius = Panel(".2")
sphere_radius = Panel(".1")
pipe = Pipe(Curve=arc.Arc, Radius=pipe_radius, Caps=2, FitRail=True)
sphere = Sphere(Base=unit_z, Radius=sphere_radius)
solid_difference = SolidDifference(BrepsA=brep, BrepsB=pipe)
out = Merge(Data1=sphere, Data2=solid_difference)

# ---- group: Entwine Geo
entwine = Entwine(Branch00=out, FlattenInputs=True)

# ----
geo_out = Data(entwine)

# ---- group: In Rhino, set Bella materials per layer, then sync Layer List to Geom List
layerlist = ValueList({"Default": 0, "Layer 01": 1, "Layer 02": 2, "Layer 03": 3, "Layer 04": 4, "Layer 05": 5}, selected="Layer 03")
layerlist_2 = ValueList({"Default": 0, "Layer 01": 1, "Layer 02": 2, "Layer 03": 3, "Layer 04": 4, "Layer 05": 5}, selected="Layer 01")
layerlist_3 = ValueList({"Default": 0, "Layer 01": 1, "Layer 02": 2, "Layer 03": 3, "Layer 04": 4, "Layer 05": 5}, selected="Layer 02")

# ---- group: In Rhino, set Bella materials per layer, then sync Layer List to Geom List / Entwine Layer
entwine_2 = Entwine(Branch00=layerlist_2, Branch01=layerlist_3, Branch02=layerlist, FlattenInputs=True)

# ---- group: In Rhino, set Bella materials per layer, then sync Layer List to Geom List (continued)
layer_out = Data(entwine_2)
