# Grasshopper definition dodecy_spherey.gh (Grasshopper 1.0.8)
# plug-ins: GhPolyhedra

# ----
# Plot 12 verts of icosohedron Facetdome generates polyhedral
# dual which is a dodecahedron
# FacetDome creates 12 petagonal
# polyline curves around 12 verts
# 12 trimmed surfaces share 0
# edges, so we have 60 edges
# 
# brep join,merges coincident
# edges resulting in 30
# 12 verts of an icosohedron,
# manually calculated in C#
# using golden ratio
# Cast curves to 12 BRep
# Trimmed Surfaces
icosohedron_vertices = CSharpScript()  # -> out, a
# ---------- icosohedron_vertices: C# ----------
// Plot 12 vertices of unit icosohedron into var a
// 12 vertices
// 20 equilateral triangular faces
// 30 edges
// no pentagonal faces but exhibits pentagonal symmetry around each vertex, 5 triangles meete forming a pentagonal arrangemnet

// Golden ratio needed for pentagonal geometry , phi
// phi is irrational ( can't be expressed as a simple fraction )
// phi^2 = phi +1 = phi^2 - phi -1 = 0 ( quadratic equation)
// (1 + sqrt(5)) / 2 = 1.6180339 ratio of pentagon's diagonals to sides
double phi = (1 + System.Math.Sqrt(5)) / 2;

System.Collections.Generic.List<Rhino.Geometry.Point3d> points = new System.Collections.Generic.List<Rhino.Geometry.Point3d>();

// Cyclic permutations of (0, ±1, ±phi)
//  shift values in a circular manner
// (ABC) (BCA) (CAB) only ones obtained by rotation (ACB) (BAC) not included
// (xyz)
// (0,1, phi) x=0, y=1, z=phi
// (1,phi,0) x=1, y=phi, z=0
// (phi,0,1) x=phi, y=0, z=1
// then incorporate +- to cover 4 quadrants symmetrically

// Loop all sign combinations
for (int s1 = -1; s1 <= 1; s1 += 2) {
    for (int s2 = -1; s2 <= 1; s2 += 2) {
        points.Add(new Rhino.Geometry.Point3d(0, s1 * 1, s2 * phi));
        points.Add(new Rhino.Geometry.Point3d(s1 * 1, s2 * phi, 0));
        points.Add(new Rhino.Geometry.Point3d(s2 * phi, 0, s1 * 1));
    }
}

// Explicitly add all 12 points without loops (unrolled from the sign combinations)

// Combination 1: s1 = -1, s2 = -1
//points.Add(new Rhino.Geometry.Point3d(0, -1 * 1, -1 * phi));  // (0, -1, -phi)
//points.Add(new Rhino.Geometry.Point3d(-1 * 1, -1 * phi, 0));  // (-1, -phi, 0)
//points.Add(new Rhino.Geometry.Point3d(-1 * phi, 0, -1 * 1));  // (-phi, 0, -1)

// Combination 2: s1 = -1, s2 = 1
//points.Add(new Rhino.Geometry.Point3d(0, -1 * 1, 1 * phi));   // (0, -1, phi)
//points.Add(new Rhino.Geometry.Point3d(-1 * 1, 1 * phi, 0));   // (-1, phi, 0)
//points.Add(new Rhino.Geometry.Point3d(1 * phi, 0, -1 * 1));   // (phi, 0, -1)

// Combination 3: s1 = 1, s2 = -1
//points.Add(new Rhino.Geometry.Point3d(0, 1 * 1, -1 * phi));   // (0, 1, -phi)
//points.Add(new Rhino.Geometry.Point3d(1 * 1, -1 * phi, 0));   // (1, -phi, 0)
//points.Add(new Rhino.Geometry.Point3d(-1 * phi, 0, 1 * 1));   // (-phi, 0, 1)

// Combination 4: s1 = 1, s2 = 1
//points.Add(new Rhino.Geometry.Point3d(0, 1 * 1, 1 * phi));    // (0, 1, phi)
//points.Add(new Rhino.Geometry.Point3d(1 * 1, 1 * phi, 0));    // (1, phi, 0)
//points.Add(new Rhino.Geometry.Point3d(1 * phi, 0, 1 * 1));    // (phi, 0, 1)

System.Collections.Generic.List<Rhino.Geometry.Point3d> normalized = new System.Collections.Generic.List<Rhino.Geometry.Point3d>();

// Normalize to unit sphere
// Compute magnitude once (using formula for efficiency—no need to reference a point)
double magnitude = System.Math.Sqrt(1 + phi * phi);  // Equivalent to sqrt(1 + phi^2)

foreach (var p in points) {
    double norm = System.Math.Sqrt(p.X * p.X + p.Y * p.Y + p.Z * p.Z);
    normalized.Add(new Rhino.Geometry.Point3d(p.X / magnitude, p.Y / magnitude, p.Z / magnitude));
}

a = normalized;
# ---------- end icosohedron_vertices ----------
dual_dodecahedron = FacetDome(Points=icosohedron_vertices.a)  # -> Pattern, Dome
brep = Brep(dual_dodecahedron.Pattern)
brep_join = BrepJoin(Breps=brep)  # -> Breps, Closed

random = Random(Range=Domain(0.2, 3), Number=12, Seed=2)

# ----
# Dumb way to count all edges,
# the edges input should cast a
# list of prims inot a count of prims
brep_edges = BrepEdges(Brep=brep_join.Breps)  # -> Naked, Interior, NonManifold
list_length = ListLength(List=brep_edges.Interior)
series = Series(Start=0, Step=1, Count=list_length)

get_face_normals = Planar(Curve=dual_dodecahedron.Pattern)  # -> Planar, Plane, Deviation
# List 12 normals for 12 pentagon faces
extrudedepth = Slider(0.416, range=0.05..10)
minimum_extrude = Slider(3, range=0..10)
extract_vector_list = DeconstructPlane(Plane=get_face_normals.Plane)  # -> Origin, XAxis, YAxis, ZAxis
scale_normal = Multiplication(A=extract_vector_list.ZAxis, B=minimum_extrude)
scale = Scale(Geometry=brep_join.Breps, Center=Point(0, 0, 0), Factor=Slider(1, range=0..10))  # -> Geometry, Transform
range = Range(Domain=Domain(0, 119), Steps=119)
pi = Pi(Factor=Slider(2, range=0..10))
pi_2 = Pi(Factor=Slider(0.2, range=0..2))
series_2 = Series(Start=0, Step=1, Count=Slider(120, range=0..1000))
sine = Sine(Value=series_2)
fillet = ControlKnob(Decimals=2, Limit=True, Maximum=0.25, Minimum=0.05, Range=0.25, Value=0.13)
fillet_edge = FilletEdge(Shape=brep_join.Breps, Blend=0, Metric=0, Edges=flatten(series), Radii=fillet)
division = Division(A=pi, B=Slider(120, range=0..1000))
# Frame
multiplication = Multiplication(A=series_2, B=pi_2)
expression = Expression(x=series_2, y=Slider(4, range=0..10), Expression="sin( (x / 120) * 2 * Pi * y )")
expression_2 = Expression(x=expression, y=Slider(2, range=0..10), Expression="x/(1+y*(1-x))")
addition = Addition(A=expression_2, B=Slider(0, range=0..1))
unit_z = UnitZ(Factor=1)
multiplication_2 = Multiplication(A=unit_z, B=addition)
quick_graph = QuickGraph(expression, SortOrder=0)
frame = Slider(0, range=0..120)
addition_2 = Addition(A=random, B=frame)
expression_3 = Expression(x=addition_2, y=Slider(4, range=0..10), Expression="sin( (x / 120) * 2 * Pi * y )")
multiplication_3 = Multiplication(A=expression_3, B=extrudedepth)
scale_normal_2 = Multiplication(A=extract_vector_list.ZAxis, B=multiplication_3)
addition_3 = Addition(A=scale_normal, B=scale_normal_2)
brep_extrude = Extrude(Base=dual_dodecahedron.Pattern, Direction=addition_3)
cap_holes = CapHoles(Brep=brep_extrude)
multiplication_4 = Multiplication(A=scale_normal_2, B=Slider(7, range=0..10))
solid_union = SolidUnion(Breps=[scale.Geometry, cap_holes])
brep_edges_2 = BrepEdges(Brep=solid_union)  # -> Naked, Interior, NonManifold
list_length_2 = ListLength(List=brep_edges_2.Interior)
multiplication_5 = Multiplication(A=division, B=frame)
series_3 = Series(Start=0, Step=1, Count=list_length_2)
sine_2 = Sine(Value=multiplication_5)
fillet_edge_2 = FilletEdge(Shape=solid_union, Blend=0, Metric=0, Edges=series_3, Radii=fillet)
addition_4 = Addition(A=sine_2, B=Slider(0.554, range=0..1))
multiplication_6 = Multiplication(A=multiplication_2, B=Slider(5, range=0..10))
list_item = ListItem(List=multiplication_6, Index=frame, Wrap=True)
deconstruct_vector = DeconstructVector(Vector=list_item)  # -> XComponent, YComponent, ZComponent
multiplication_7 = Multiplication(A=addition_4, B=Slider(1, range=1..5))
addition_5 = Addition(A=Slider(2.01, range=0..3), B=multiplication_7)
addition_6 = Addition(A=Slider(2, range=0..10), B=multiplication_7)
quick_graph_2 = QuickGraph(addition, SortOrder=0)
sphere = Sphere(Base=PlaneXY(0, 0, 0), Radius=addition_5)
sphere_2 = Sphere(Base=PlaneXY(0, 0, 0), Radius=addition_6)
solid_difference = SolidDifference(BrepsA=fillet_edge_2, BrepsB=sphere)
final_scale = Slider(10, range=0..10)
solid_intersection = SolidIntersection(BrepsA=sphere_2, BrepsB=solid_union)
# 1 To 1
third_of_frames = Slider(40, range=0..100)
solid_difference_2 = SolidDifference(BrepsA=solid_intersection, BrepsB=solid_union)
# List of numbers
# 0 To 0
range_2 = Range(Domain=Domain(0, 0), Steps=third_of_frames)
# 0 To 1
range_3 = Range(Domain=Domain(0, 1), Steps=third_of_frames)
range_4 = Range(Domain=Domain(1, 1), Steps=third_of_frames)
brep_2 = Brep(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)
# Easein Easeout expression
expression_4 = Expression(x=range_3, Expression="0.5 * ( 1 - cos(x * Pi))")
rotz = Merge(Data1=expression_4, Data2=range_4, Data3=range_4)
rotx = Merge(Data1=range_2, Data2=expression_4, Data3=range_4)
roty = Merge(Data1=range_2, Data2=range_2, Data3=expression_4)
pi_3 = Pi(Factor=1)
icosphere = IcoSphere(Plane=PlaneXY(0, 0, 0), Scale=1, Density=0)
rotz_2 = Multiplication(A=rotz, B=pi_3)
roty_2 = Multiplication(A=roty, B=pi_3)
rotx_2 = Multiplication(A=rotx, B=pi_3)
xz_plane = XZPlane(Origin=Point(0, 0, 0))
yz_plane = YZPlane(Origin=Point(0, 0, 0))
list_item_2 = ListItem(List=rotz_2, Index=frame, Wrap=True)
rotate = Rotate(Geometry=solid_difference_2, Angle=list_item_2, Plane=PlaneXY(0, 0, 0))  # -> Geometry, Transform
list_item_3 = ListItem(List=rotx_2, Index=frame, Wrap=True)
list_item_4 = ListItem(List=roty_2, Index=frame, Wrap=True)
rotate_2 = Rotate(Geometry=rotate.Geometry, Angle=list_item_3, Plane=xz_plane)  # -> Geometry, Transform
rotate_3 = Rotate(Geometry=rotate_2.Geometry, Angle=list_item_4, Plane=yz_plane)  # -> Geometry, Transform
merge = Merge(Data1=rotate_3.Geometry, Data2=solid_difference)
scale_2 = Scale(Geometry=merge, Center=Point(0, 0, 0), Factor=final_scale)  # -> Geometry, Transform
out = Geometry(scale_2.Geometry)

# ---- group: Entwine Geo
entwine = Entwine(Branch00=rotate_2.Geometry, FlattenInputs=True)

# ----
geo_out = Data(entwine)

# ---- group: In Rhino, set Bella materials per layer, then sync Layer List to Geom List
layerlist = ValueList({"Default": 0, "Layer 01": 1, "Layer 02": 2, "Layer 03": 3, "Layer 04": 4, "Layer 05": 5}, selected="Layer 03")
layerlist_2 = ValueList({"Default": 0, "Layer 01": 1, "Layer 02": 2, "Layer 03": 3, "Layer 04": 4, "Layer 05": 5}, selected="Layer 01")
layerlist_3 = ValueList({"Default": 0, "Layer 01": 1, "Layer 02": 2, "Layer 03": 3, "Layer 04": 4, "Layer 05": 5}, selected="Layer 02")

# ---- group: In Rhino, set Bella materials per layer, then sync Layer List to Geom List / Entwine Layer
entwine_2 = Entwine(Branch00=layerlist_2, Branch01=layerlist_3, Branch02=layerlist, FlattenInputs=True)

# ---- group: In Rhino, set Bella materials per layer, then sync Layer List to Geom List (continued)
layer_out = Data(entwine_2)
