# Grasshopper definition rubiky_cubey.gh (Grasshopper 1.0.8)
# Copyright: Harvey Fong

keyframes = Panel("""0,
14,
17,
48,
52,
58,
64,
70,
75,
80,
89,
100,
108,
110,
120,
124""")
keyframes_2 = Panel("""0,
4,
32,
48,
52,
58,
64,
70,
75,
80,
89,
100,
108,
110,
115""")
keyframes_3 = Panel("""0,
3,
32,
48,
52,
58,
64,
70,
75,
80,
89,
100,
108,
110,
115""")
keyframes_4 = Panel("""0,
10,
32,
48,
52,
58,
64,
72,
75,
88,
96,
104,
108,
115,
120""")
keyframes_5 = Panel("""0,
10,
32,
48,
52,
58,
64,
72,
75,
80,
89,
100,
108,
110,
115""")
keyframes_6 = Panel("""0,
10,
22,
30,
38,
46,
54,
62,
77,
81,
86,
92,
95,
110,
120""")
keyframes_7 = Panel("""4,
8,
16,
24,
32,
45,
54,
60,
65,
71,
76,
84,
87,
100,
110""")
edges = Panel("""1,
7,
6,
8,
8,
10,
9,
7,
3,
1,
2,
4,
8,
11,
9,
0""")
edges_2 = Panel("""1,
7,
6,
8,
8,
10,
9,
7,
3,
1,
2,
4,
8,
11,
9""")
edges_3 = Panel("""1,
7,
6,
8,
8,
10,
9,
7,
3,
1,
2,
4,
8,
11,
9""")
edges_4 = Panel("""1,
7,
6,
8,
8,
10,
9,
7,
3,
1,
2,
4,
8,
11,
9""")
edges_5 = Panel("""1,
7,
6,
8,
8,
10,
9,
7,
3,
1,
2,
4,
8,
11,
9""")
edges_6 = Panel("""1,
11,
3,
2,
1,
8,
9,
11,
3,
1,
2,
4,
8,
8,
2""")
angles = Panel("""0,
180,
0,
180,
0,
90,
0,
180,
0,
90,
0,
90,
0,
0,
-90""")
angles_2 = Panel("""0,
0,
0,
0,
0,
0,
0,
0,
0,
0,
0,
0,
0,
0,
0,
0""")
angles_3 = Panel("""0,
0,
0,
0,
0,
0,
0,
0,
0,
0,
0,
0,
0,
0,
0""")
angles_4 = Panel("""0,
0,
0,
0,
0,
0,
0,
0,
0,
0,
0,
0,
0,
0,
0""")
angles_5 = Panel("""0,
90,
0,
0,
-180,
90,
0,
90,
0,
0,
90,
0,
0,
-180,
0""")
angles_6 = Panel("""0,
0,
0,
0,
0,
0,
0,
0,
0,
0,
0,
0,
0,
0,
0""")
angles_7 = Panel("""0,
0,
0,
90,
0,
0,
-180,
0,
-90,
0,
90,
0,
0,
-270,
0""")

# ----
# Fillet box
x_origin = Slider(0, range=0..5)
y_origin = Slider(0, range=0..5)
z_origin = Slider(0, range=0..5)
construct_point = ConstructPoint(XCoordinate="0.9998", YCoordinate="0.9998", ZCoordinate="0.9998")
construct_point_2 = ConstructPoint(XCoordinate=".0002", YCoordinate=".0002", ZCoordinate=".0002")
addition = Addition(A=construct_point_2, B=construct_point)
box_2pt = Box2Pt(PointA=construct_point_2, PointB=addition, Plane=PlaneXY(0, 0, 0))
brep = Brep(box_2pt)
series = Series(Start=0, Step=1, Count="12")
fillet_edge = FilletEdge(Shape=brep, Blend=0, Metric=0, Edges=series, Radii=Slider(0.1, range=0..1))

edges_7 = Panel("""0,
1,
0,
0,
0,
3,
4,
0,
5,
1,
2,
4,
5,
11,
0""")
translates = Panel("""1 -1 -1,
0 0 0,
0 -1 0,
0 0 0,
1 0 0,
0 0 0,
0 0 0,
0 0 0,
0 0 0,
-1 0 0,
0 0 0,
0 0 0,
0 0 0,
0 0 0,
0 0 0,
0 1 0""")
translates_2 = Panel("""1 0 -1,
0 0 -1,
0 0 0,
0 0 1,
0 0 0,
0 0 0,
0 0 0,
0 0 0,
0 0 0,
0 0 0,
0 0 0,
0 0 0,
0 0 0,
0 0 0,
0 0 0""")
translates_3 = Panel("""1 0 0,
0 1 0,
0 0 0,
0 0 0,
0 0 0,
0 0 0,
0 0 0,
0 0 0,
0 0 0,
0 0 0,
0 -1 0,
0 0 0,
0 0 0,
0 0 0,
0 0 0""")
translates_4 = Panel("""1 -1 0,
0 0 0,
0 0 0,
0 -1 0,
0 1 0,
0 0 0,
0 0 0,
0 0 0,
0 0 0,
0 0 -1,
0 0 0,
0 2 0,
0 0 0,
0 0 0,
0 0 1""")
translates_5 = Panel("""0 0 -1,
0 0 0,
0 0 0,
0 0 0,
0 0 0,
0 0 0,
0 0 0,
0 0 0,
0 0 0,
0 0 0,
0 0 0,
-1 0 0,
0 0 0,
0 0 0,
1 0 0""")
# Animation
translates_6 = Panel("""0 0 0,
0 0 0,
0 0 0,
0 0 0,
0 0 0,
0 0 0,
0 0 0,
0 0 0,
0 0 0,
0 0 0,
-1 0 0,
0 0 0,
0 0 -2,
0 -1 0,
0 0 0""")
translates_7 = Panel("""0 -1 0,
0 0 0,
-1 0 0,
0 0 0,
0 0 0,
0 -1 0,
0 0 0,
0 0 0,
0 0 0,
0 0 0,
0 0 0,
0 0 -1,
0 0 0,
0 0 0,
0 0 -1""")
listy_of_durations = TextSplit(ActionDurations=keyframes, Separators=",")
action_angles_csv_1 = TextSplit(ActionAngles=angles_2, Separators=",")
action_edges_csv_1 = TextSplit(ActionEdges=edges, Separators=",")
action_edges_csv_1_2 = TextSplit(ActionTranslates=translates, Separators=",")
listy_of_durations_2 = TextSplit(ActionDurations=keyframes_2, Separators=",")
action_angles_csv_1_2 = TextSplit(ActionAngles=angles_3, Separators=",")
action_edges_csv_1_3 = TextSplit(ActionEdges=edges_2, Separators=",")
action_edges_csv_1_4 = TextSplit(ActionTranslates=translates_2, Separators=",")
listy_of_durations_3 = TextSplit(ActionDurations=keyframes_3, Separators=",")
action_angles_csv_1_3 = TextSplit(ActionAngles=angles_4, Separators=",")
action_edges_csv_1_5 = TextSplit(ActionEdges=edges_3, Separators=",")
action_edges_csv_1_6 = TextSplit(ActionTranslates=translates_3, Separators=",")
listy_of_durations_4 = TextSplit(ActionDurations=keyframes_4, Separators=",")
action_angles_csv_1_4 = TextSplit(ActionAngles=angles_5, Separators=",")
action_edges_csv_1_7 = TextSplit(ActionEdges=edges_4, Separators=",")
action_edges_csv_1_8 = TextSplit(ActionTranslates=translates_4, Separators=",")
listy_of_durations_5 = TextSplit(ActionDurations=keyframes_5, Separators=",")
action_angles_csv_1_5 = TextSplit(ActionAngles=angles_6, Separators=",")
action_edges_csv_1_9 = TextSplit(ActionEdges=edges_5, Separators=",")
action_edges_csv_1_10 = TextSplit(ActionTranslates=translates_5, Separators=",")
listy_of_durations_6 = TextSplit(ActionDurations=keyframes_7, Separators=",")
action_angles_csv_1_6 = TextSplit(ActionAngles=angles, Separators=",")
action_edges_csv_1_11 = TextSplit(ActionEdges=edges_7, Separators=",")
action_edges_csv_1_12 = TextSplit(ActionTranslates=translates_6, Separators=",")
listy_of_durations_7 = TextSplit(ActionDurations=keyframes_6, Separators=",")
action_angles_csv_1_7 = TextSplit(ActionAngles=angles_7, Separators=",")
action_edges_csv_1_13 = TextSplit(ActionEdges=edges_6, Separators=",")
action_edges_csv_1_14 = TextSplit(ActionTranslates=translates_7, Separators=",")
construct_point_3 = ConstructPoint(XCoordinate="0.5", YCoordinate="0.5", ZCoordinate="0.5")
frame = Slider(0, range=0..124)
python_3_script = Python3Script(
    Keyframes=listy_of_durations,
    Edges=action_edges_csv_1,
    Angles=action_angles_csv_1,
    Translates=action_edges_csv_1_2,
    CurrentFrame=frame)  # -> out, OutBox, OutMatrix, OutLabels; inputs Keyframes: list of Double, Edges: list of Int32, Angles: list of Double, Translates: list of String, CurrentFrame: Double
# ---------- python_3_script: Python ----------
import Rhino
import math

# ---------------------------------------------------------
# 0. PARSER & INTERNAL SETUP
# ---------------------------------------------------------
action_vectors = []
for item in Translates:
    lines = str(item).splitlines()
    for line in lines:
        clean_str = line.replace(',', ' ').replace('/', ' ')
        parts = clean_str.split()
        if len(parts) >= 3:
            vec = Rhino.Geometry.Vector3d(float(parts[0]), float(parts[1]), float(parts[2]))
            action_vectors.append(vec)

bbox = Rhino.Geometry.BoundingBox(0.0, 0.0, 0.0, 1.0, 1.0, 1.0)
BaseBox = Rhino.Geometry.Box(bbox).ToBrep()

def ease_in_out(t):
    return t * t * (3.0 - 2.0 * t)

# ---------------------------------------------------------
# 1. SETUP THE BASE STATE (Frame 0 Initial Orientation)
# ---------------------------------------------------------
# Safely extract Index 0 for our starting state
start_translate = action_vectors[0] if len(action_vectors) > 0 else Rhino.Geometry.Vector3d.Zero
start_angle_deg = Angles[0] if len(Angles) > 0 else 0.0
start_edge_idx = int(Edges[0]) if len(Edges) > 0 else 0

# Calculate the initial rotation (if any)
if start_angle_deg != 0.0:
    base_edge = BaseBox.Edges[start_edge_idx].EdgeCurve
    axis_origin = base_edge.PointAtStart
    axis_direction = base_edge.PointAtEnd - base_edge.PointAtStart
    start_rot_rad = math.radians(start_angle_deg)
    start_rotation = Rhino.Geometry.Transform.Rotation(start_rot_rad, axis_direction, axis_origin)
else:
    start_rotation = Rhino.Geometry.Transform.Identity

# Calculate the initial translation
start_translation = Rhino.Geometry.Transform.Translation(start_translate)

# Bake the initial orientation and position into the master transform
# Matrix order: Apply rotation first, then move it to the starting location
master_transform = start_translation * start_rotation

num_moves = len(Keyframes) - 1

# ---------------------------------------------------------
# 2. THE TIME MACHINE LOOP
# ---------------------------------------------------------
for i in range(num_moves):
    
    start_frame = Keyframes[i]
    end_frame = Keyframes[i+1]
    
    if CurrentFrame <= start_frame:
        break
        
    if CurrentFrame >= end_frame:
        progress = 1.0
    else:
        raw_progress = float(CurrentFrame - start_frame) / float(end_frame - start_frame)
        progress = ease_in_out(raw_progress)
        
    # --- SHIFTED DATA FETCHING ---
    # Move 'i' pulls its delta data from index 'i + 1'
    data_index = i + 1
    
    current_angle_target = Angles[data_index] if data_index < len(Angles) else 0.0
    current_edge_index = int(Edges[data_index]) if data_index < len(Edges) else 0
    current_translation_target = action_vectors[data_index] if data_index < len(action_vectors) else Rhino.Geometry.Vector3d.Zero
    
    target_angle_rad = math.radians(current_angle_target * progress)
    current_translation_vec = current_translation_target * progress
    
    # ---------------------------------------------------------
    # 3. THE TRANSFORMATION MATH
    # ---------------------------------------------------------
    base_edge_curve = BaseBox.Edges[current_edge_index].EdgeCurve
    
    current_axis = base_edge_curve.Duplicate()
    current_axis.Transform(master_transform)
    
    axis_origin = current_axis.PointAtStart
    axis_direction = current_axis.PointAtEnd - current_axis.PointAtStart
    
    step_rotation = Rhino.Geometry.Transform.Rotation(target_angle_rad, axis_direction, axis_origin)
    step_translation = Rhino.Geometry.Transform.Translation(current_translation_vec)
    
    step_combined = step_translation * step_rotation
    master_transform = step_combined * master_transform

# ---------------------------------------------------------
# 4. EXECUTE FINAL INSTRUCTION & LABELS
# ---------------------------------------------------------
AnimatedBox = BaseBox.Duplicate()
AnimatedBox.Transform(master_transform)

labels = []
for i, edge in enumerate(AnimatedBox.Edges):
    crv = edge.EdgeCurve
    mid_param = (crv.Domain.Min + crv.Domain.Max) / 2.0
    dot = Rhino.Geometry.TextDot(str(i), crv.PointAt(mid_param))
    labels.append(dot)

OutBox = AnimatedBox
OutMatrix = master_transform
OutLabels = labels
# ---------- end python_3_script ----------
python_3_script_2 = Python3Script(
    Keyframes=listy_of_durations_2,
    Edges=action_edges_csv_1_3,
    Angles=action_angles_csv_1_2,
    Translates=action_edges_csv_1_4,
    CurrentFrame=frame)  # -> out, OutBox, OutMatrix, OutLabels; inputs Keyframes: list of Double, Edges: list of Int32, Angles: list of Double, Translates: list of String, CurrentFrame: Double; same code as python_3_script
python_3_script_3 = Python3Script(
    Keyframes=listy_of_durations_3,
    Edges=action_edges_csv_1_5,
    Angles=action_angles_csv_1_3,
    Translates=action_edges_csv_1_6,
    CurrentFrame=frame)  # -> out, OutBox, OutMatrix, OutLabels; inputs Keyframes: list of Double, Edges: list of Int32, Angles: list of Double, Translates: list of String, CurrentFrame: Double; same code as python_3_script
python_3_script_4 = Python3Script(
    Keyframes=listy_of_durations_4,
    Edges=action_edges_csv_1_7,
    Angles=action_angles_csv_1_4,
    Translates=action_edges_csv_1_8,
    CurrentFrame=frame)  # -> out, OutBox, OutMatrix, OutLabels; inputs Keyframes: list of Double, Edges: list of Int32, Angles: list of Double, Translates: list of String, CurrentFrame: Double; same code as python_3_script
python_3_script_5 = Python3Script(
    Keyframes=listy_of_durations_5,
    Edges=action_edges_csv_1_9,
    Angles=action_angles_csv_1_5,
    Translates=action_edges_csv_1_10,
    CurrentFrame=frame)  # -> out, OutBox, OutMatrix, OutLabels; inputs Keyframes: list of Double, Edges: list of Int32, Angles: list of Double, Translates: list of String, CurrentFrame: Double; same code as python_3_script
# Boolean bubbles on surface
python_3_script_6 = Python3Script(
    Keyframes=listy_of_durations_6,
    Edges=action_edges_csv_1_11,
    Angles=action_angles_csv_1_6,
    Translates=action_edges_csv_1_12,
    CurrentFrame=frame)  # -> out, OutBox, OutMatrix, OutLabels; inputs Keyframes: list of Double, Edges: list of Int32, Angles: list of Double, Translates: list of String, CurrentFrame: Double; same code as python_3_script
python_3_script_7 = Python3Script(
    Keyframes=listy_of_durations_7,
    Edges=action_edges_csv_1_13,
    Angles=action_angles_csv_1_7,
    Translates=action_edges_csv_1_14,
    CurrentFrame=frame)  # -> out, OutBox, OutMatrix, OutLabels; inputs Keyframes: list of Double, Edges: list of Int32, Angles: list of Double, Translates: list of String, CurrentFrame: Double; same code as python_3_script
bubble_seed = Slider(0.6, range=0.1..0.8)
bubble_seed_2 = Slider(0.5, range=0.1..0.8)
bubble_seed_3 = Slider(0.4, range=0.1..0.8)
bubble_seed_4 = Slider(0.8, range=0.1..0.8)
bubble_seed_5 = Slider(0.1, range=0.1..0.8)
bubble_seed_6 = Slider(0.3, range=0.1..0.8)
panel = Panel("-3")
scale = Scale(Geometry=fillet_edge, Center=construct_point_3, Factor="0.9")  # -> Geometry, Transform
construct_point_4 = ConstructPoint(XCoordinate=0, YCoordinate=0, ZCoordinate=Slider(-1, range=-3..0))
construct_point_5 = ConstructPoint(XCoordinate="-30", YCoordinate="-30", ZCoordinate=0)
construct_point_6 = ConstructPoint(XCoordinate="30", YCoordinate="30", ZCoordinate=0)
panel_2 = Panel("2")
construct_point_7 = ConstructPoint(XCoordinate=Slider(2.002, range=0..5), YCoordinate=Slider(-2, range=-20..20), ZCoordinate=Slider(2, range=-20..20))
construct_plane = ConstructPlane(Origin=construct_point_4, XAxis=Vector(1, 0, 0), YAxis=Vector(0, 1, 0))
populate_3d = Populate3D(Region=scale.Geometry, Count=Slider(9, range=1..30), Seed=1)
list_length = ListLength(List=populate_3d)
random = Random(Range=Domain(0.05, 0.15), Number=list_length, Seed=2)
random_2 = Random(Range=Domain(0.05, 0.15), Number=list_length, Seed=bubble_seed)
random_3 = Random(Range=Domain(0.05, 0.15), Number=list_length, Seed=bubble_seed_4)
random_4 = Random(Range=Domain(0.05, 0.15), Number=list_length, Seed=bubble_seed_3)
random_5 = Random(Range=Domain(0.05, 0.15), Number=list_length, Seed=bubble_seed_5)
random_6 = Random(Range=Domain(0.05, 0.15), Number=list_length, Seed=bubble_seed_2)
random_7 = Random(Range=Domain(0.05, 0.15), Number=list_length, Seed=bubble_seed_6)
sphere = Sphere(Base=populate_3d, Radius=random_2)
sphere_2 = Sphere(Base=populate_3d, Radius=random)
sphere_3 = Sphere(Base=populate_3d, Radius=random_3)
sphere_4 = Sphere(Base=populate_3d, Radius=random_4)
sphere_5 = Sphere(Base=populate_3d, Radius=random_5)
sphere_6 = Sphere(Base=populate_3d, Radius=random_6)
sphere_7 = Sphere(Base=populate_3d, Radius=random_7)
rectangle_2pt = Rectangle2Pt(Plane=construct_plane, PointA=construct_point_5, PointB=construct_point_6, Radius=".3")  # -> Rectangle, Length
solid_difference = SolidDifference(BrepsA=fillet_edge, BrepsB=sphere)
transform = Transform(Geometry=solid_difference, Transform=python_3_script_7.OutMatrix)
solid_difference_2 = SolidDifference(BrepsA=fillet_edge, BrepsB=sphere_2)
transform_2 = Transform(Geometry=solid_difference_2, Transform=python_3_script_6.OutMatrix)
solid_difference_3 = SolidDifference(BrepsA=fillet_edge, BrepsB=sphere_3)
transform_3 = Transform(Geometry=solid_difference_3, Transform=python_3_script_2.OutMatrix)
solid_difference_4 = SolidDifference(BrepsA=fillet_edge, BrepsB=sphere_5)
transform_4 = Transform(Geometry=solid_difference_4, Transform=python_3_script_4.OutMatrix)
merge = Merge(Data1=transform_2, Data2=transform_4, Data3=transform_3)
solid_difference_5 = SolidDifference(BrepsA=fillet_edge, BrepsB=sphere_6)
transform_5 = Transform(Geometry=solid_difference_5, Transform=python_3_script_3.OutMatrix)
solid_difference_6 = SolidDifference(BrepsA=fillet_edge, BrepsB=sphere_7)
transform_6 = Transform(Geometry=solid_difference_6, Transform=python_3_script.OutMatrix)
solid_difference_7 = SolidDifference(BrepsA=fillet_edge, BrepsB=sphere_4)
transform_7 = Transform(Geometry=solid_difference_7, Transform=python_3_script_5.OutMatrix)
merge_2 = Merge(Data2=transform, Data4=transform_7, Data5=transform_5, Data7=transform_6)
construct_point_8 = ConstructPoint(XCoordinate=Slider(-0.158, range=-9..10), YCoordinate=Slider(1.055, range=-7..4), ZCoordinate=Slider(-3, range=-20..20))
box_2pt_2 = Box2Pt(PointA=construct_point_8, PointB=construct_point_7, Plane=PlaneXY(0, 0, 0))
scale_2 = Scale(Geometry=merge_2, Center=Point(0, 0, 0), Factor="10")  # -> Geometry, Transform
brep_2 = Brep(box_2pt_2)
boundary_surfaces = BoundarySurfaces(Edges=rectangle_2pt.Rectangle)
deconstruct_brep = DeconstructBrep(Brep=box_2pt_2)  # -> Faces, Edges, Vertices
solid_difference_8 = SolidDifference(BrepsA=boundary_surfaces, BrepsB=brep_2)
brep_edges = BrepEdges(Brep=solid_difference_8)  # -> Naked, Interior, NonManifold
layerlist = ValueList({"Default": 0, "Layer 01": 1, "Layer 02": 2, "Layer 03": 3, "Layer 04": 4, "Layer 05": 5}, selected="Layer 04")
layerlist_2 = ValueList({"Default": 0, "Layer 01": 1, "Layer 02": 2, "Layer 03": 3, "Layer 04": 4, "Layer 05": 5}, selected="Layer 05")
list_item = ListItem(List=deconstruct_brep.Faces, Index=Slider(4, range=0..14), Wrap=True)
unit_z = UnitZ(Factor=0.1)
list_length_2 = ListLength(List=brep_edges.Interior)
move = Move(Geometry=list_item, Motion=unit_z)  # -> Geometry, Transform
mesh = Mesh(move.Geometry)
series_2 = Series(Start=0, Step=1, Count=list_length_2)
fillet_edge_2 = FilletEdge(Shape=solid_difference_8, Blend=0, Metric=0, Edges=series_2, Radii=Slider(0.05, range=0..0.1))
scale_3 = Scale(Geometry=fillet_edge_2, Center=Point(0, 0, 0), Factor="10")  # -> Geometry, Transform

# ---- group: Entwine Geo
entwine = Entwine(Branch00=fillet_edge_2, Branch01=merge_2, Branch02=mesh, Branch03=merge, FlattenInputs=True)

# ----
geo_out = Data(entwine)
scale_4 = Scale(Geometry=mesh, Center=Point(0, 0, 0), Factor="10")  # -> Geometry, Transform

# ---- group: In Rhino, set Bella materials per layer, then sync Layer List to Geom List
layerlist_3 = ValueList({"Default": 0, "Layer 01": 1, "Layer 02": 2, "Layer 03": 3, "Layer 04": 4, "Layer 05": 5}, selected="Layer 03")
layerlist_4 = ValueList({"Default": 0, "Layer 01": 1, "Layer 02": 2, "Layer 03": 3, "Layer 04": 4, "Layer 05": 5}, selected="Layer 01")
layerlist_5 = ValueList({"Default": 0, "Layer 01": 1, "Layer 02": 2, "Layer 03": 3, "Layer 04": 4, "Layer 05": 5}, selected="Layer 02")

# ---- group: In Rhino, set Bella materials per layer, then sync Layer List to Geom List / Entwine Layer
entwine_2 = Entwine(
    Branch00=layerlist_4,
    Branch01=layerlist_5,
    Branch02=layerlist_3,
    Branch03=layerlist,
    Branch04=layerlist_2,
    FlattenInputs=True)

# ---- group: In Rhino, set Bella materials per layer, then sync Layer List to Geom List (continued)
layer_out = Data(entwine_2)
