# Grasshopper definition snakey_swimmy.gh (Grasshopper 1.0.8)
# Copyright: Harvey Fong

# ---- group: Butt together a bunch of arcs, probably a simpler way to do this
range = Range(Domain="0 To 8", Steps="2")
construct_point = ConstructPoint(XCoordinate=range, YCoordinate=0, ZCoordinate=0)
unit_x = UnitX(Factor="2")
xz_plane = XZPlane(Origin=construct_point)
arc = Arc(Plane=xz_plane, Radius=1, Angle="Pi")  # -> Arc, Length
rotate = Rotate(Geometry=arc.Arc, Angle="Pi", Plane=xz_plane)  # -> Geometry, Transform
move = Move(Geometry=arc.Arc, Motion=unit_x)  # -> Geometry, Transform
merge = Merge(Data1=rotate.Geometry, Data2=move.Geometry)

# ----
frame = Slider(0, range=0..98)

# ---- group: Oscillating brep box
sine_frequency = Slider(0.1, range=0.1..1)
center_box = CenterBox(Base=PlaneXY(0, 0, 0), X="3", Y="3", Z="1")
multiplication = Multiplication(A=frame, B=sine_frequency)
brep = Brep(center_box)
unit_x_2 = UnitX(Factor="6")
sine = Sine(Value=multiplication)
unit_z = UnitZ(Factor=sine)
addition = Addition(A=unit_z, B=unit_x_2)
move_2 = Move(Geometry=brep, Motion=addition)  # -> Geometry, Transform

# ---- group: Fillet box
fillet_radius = Slider(0.2, range=0.1..1)
series = Series(Start=0, Step=1, Count="12")
fillet_edge = FilletEdge(Shape=move_2.Geometry, Blend=0, Metric=0, Edges=series, Radii=fillet_radius)

# ---- group: Big curve joined , get domain
join_curves = JoinCurves(Curves=merge, Preserve=False)
curve_domain = CurveDomain(Curve=join_curves)  # -> Curve, Domain

# ---- group: Slice big curve to get worm curve ( anim )
remap_numbers = RemapNumbers(Value=frame, Source=Domain(1, 100), Target=curve_domain.Domain)  # -> Mapped, Clipped
remap_numbers_2 = RemapNumbers(Value=frame, Source="-20 To 80", Target=curve_domain.Domain)  # -> Mapped, Clipped
construct_domain = ConstructDomain(DomainStart=remap_numbers.Mapped, DomainEnd=remap_numbers_2.Mapped)

# ---- group: Worm pipe on worm curve
global_pipe_radius = Slider(0.3, range=0.1..1)
sub_curve = SubCurve(BaseCurve=join_curves, Domain=construct_domain)
pipe = Pipe(Curve=sub_curve, Radius=global_pipe_radius, Caps=2, FitRail=False)

# ---- group: Fat pipe for boolean
addition_2 = Addition(A=global_pipe_radius, B=".6")
pipe_2 = Pipe(Curve=sub_curve, Radius=addition_2, Caps=2, FitRail=False)
solid_difference = SolidDifference(BrepsA=fillet_edge, BrepsB=pipe_2)

# ---- group: (buggy) click button to update Layer names in LayerList
python_3_script = Python3Script(Refresh=Button())  # -> out; inputs Refresh: Boolean
# ---------- python_3_script: Python ----------
import Rhino
import Grasshopper as gh

def update_value_lists(target_name):
    # 1. Gather all active layers from the Rhino Document
    layers = Rhino.RhinoDoc.ActiveDoc.Layers
    layer_names = []
    layer_indices = []

    for layer in layers:
        if not layer.IsDeleted:
            layer_names.append(layer.Name)
            # Store the index as a string so the Value List can hold it
            layer_indices.append(str(layer.Index))

    # 2. Get the active Grasshopper document
    gh_doc = ghenv.Component.OnPingDocument()
    
    # 3. Scan the canvas for Value Lists matching our target name
    for obj in gh_doc.Objects:
        if isinstance(obj, gh.Kernel.Special.GH_ValueList):
            if obj.NickName == target_name:
                
                # Check if it already matches to prevent unnecessary recalculations
                current_names = [item.Name for item in obj.ListItems]
                if current_names == layer_names:
                    continue 
                
                # 4. Clear the old list and populate the new layers
                obj.ListItems.Clear()
                for name, idx in zip(layer_names, layer_indices):
                    item = gh.Kernel.Special.GH_ValueListItem(name, idx)
                    obj.ListItems.Add(item)
                
                # 5. Tell the Value List to update itself and push data downstream
                obj.ExpireSolution(False)

# Run the update when the user clicks the Refresh button
if Refresh:
    update_value_lists("LayerList")
# ---------- end python_3_script ----------

# ---- group: Entwine Geo
entwine = Entwine(Branch00=pipe, Branch01=solid_difference, FlattenInputs=True)

# ----
geo_out = Data(entwine)

# ---- group: In Rhino, set Bella materials per layer, then sync Layer List to Geom List
layerlist = ValueList({"Default": 0, "Layer 01": 1, "Layer 02": 2, "Layer 03": 3, "Layer 04": 4, "Layer 05": 5}, selected="Layer 03")
layerlist_2 = ValueList({"Default": 0, "Layer 01": 1, "Layer 02": 2, "Layer 03": 3, "Layer 04": 4, "Layer 05": 5}, selected="Layer 01")
layerlist_3 = ValueList({"Default": 0, "Layer 01": 1, "Layer 02": 2, "Layer 03": 3, "Layer 04": 4, "Layer 05": 5}, selected="Layer 02")

# ---- group: In Rhino, set Bella materials per layer, then sync Layer List to Geom List / Entwine Layer
entwine_2 = Entwine(Branch00=layerlist_2, Branch01=layerlist_3, Branch02=layerlist, FlattenInputs=True)

# ---- group: In Rhino, set Bella materials per layer, then sync Layer List to Geom List (continued)
layer_out = Data(entwine_2)
